vi "CLT.gvi"   [LabVIEW NXG 3.1.0]
panel indicators:
  "output array": f64[]
  "count": i32
  "Graph": T1
  "Normalized Graph": T1
types:
  T1 = cluster{"x values": f64[], "histogram h(x)": f64[]}
uses:
  NI::Analysis::Statistics::Histogram (single-shot)(DBL Array).gvi
  NI::Analysis::Statistics::Statistics (1D DBL).gvi
diagram:
  s1 = f64[] []  # shift register
  while (iteration -> i1) {
    Wait(time to wait=0)
    for (N = 100) {
      for (N = 100) {
        Random Number() -> (number (0 to 1)=w3)
        append w3 to w2
      }
      append w2 to w1
    }
    Add Array Elements(numeric array=w1) -> (sum=w4)
    Divide(x=w4, y=10000) -> w5
    Insert Into Array(inArray=s1, index0=i1, new=w5) -> w6
    $count <- i1
    Is Greater Or Equal(x=i1, y=10000) -> w7
    next s1 = w6
    stop if w7
  }
  $"output array" <- s1
  call "Histogram (single-shot)(DBL Array).gvi"(signal=s1, number of bins=100) -> (histogram=w8)
  $Graph <- w8
  call "Statistics (1D DBL).gvi"(signal=s1) -> (mean=w9, variance=w10)
  Subtract(x=s1, y=w9) -> w11
  Divide(x=w11, y=w10) -> w12
  call "Histogram (single-shot)(DBL Array).gvi"(signal=w12, number of bins=100) -> (histogram=w13)
  $"Normalized Graph" <- w13
