vi "DataTypes.gvi"   [LabVIEW NXG 3.1.0]
panel controls:
  "string": string
panel indicators:
  "unsigned byte array": f64[]
  "celcius values": f64[]
  "Average": f64
  "hot?": bool
diagram:
  String To Byte Array(string=$string) -> (unsigned byte array=w1)
  $"unsigned byte array" <- w1
  Subtract(x=w1, y=32) -> w2
  Divide(x=5, y=9) -> w3
  Multiply(w2, w3) -> w4
  $"celcius values" <- w4
  Array Size(array=w4) -> (size(s)=w5)
  Add Array Elements(numeric array=w4) -> (sum=w6)
  Divide(x=w6, y=w5) -> w7
  $Average <- w7
  Is Greater Or Equal(x=w7, y=50) -> w8
  $"hot?" <- w8
