vi "AM.gvi"   [LabVIEW NXG 3.1.0]
inputs:
  "Message Freq": f64 = 10
  "Message Amp": f64 = 1
  "Carrier Freq": f64 = 10
  "Carrier Amp": f64 = 1
  "sample rate": f64 = 1000
  "samples": i32 = 1000
outputs:
  "Message Signal Time Waveform": waveform<f64>
  "Carrier Signal Time Waveform": waveform<f64>
  "AM Signal Time Waveform": waveform<f64>
  "Message Signal PSD": T1
  "Carrier Signal PSD": T1
  "AM Signal PSD": T1
types:
  T1 = cluster{"f0": f64, "df": f64, "magnitude": f64[]}
uses:
  NI::Analysis::Generation::Sine Waveform.gvi
  NI::Analysis::Measurement::Power Spectral Density for 1 Chan.gvi
diagram:
  call "Sine Waveform.gvi"(sample rate=$"sample rate", samples=$samples, amplitude=$"Message Amp", frequency=$"Message Freq", phase in=90) -> (sine wave=w1)
  call "Power Spectral Density for 1 Chan.gvi"(signal=w1) -> (power spectral density=w2)
  $"Message Signal PSD" <- w2
  call "Sine Waveform.gvi"(sample rate=$"sample rate", samples=$samples, amplitude=$"Carrier Amp", frequency=$"Carrier Freq", phase in=90) -> (sine wave=w3)
  call "Power Spectral Density for 1 Chan.gvi"(signal=w3) -> (power spectral density=w4)
  $"Carrier Signal PSD" <- w4
  $"Message Signal Time Waveform" <- w1
  $"Carrier Signal Time Waveform" <- w3
  Waveform Multiply(w3, w1) -> w5
  Waveform Divide(x=w5, y=$"Carrier Amp") -> w6
  Waveform Add(w3, w6) -> w7
  $"AM Signal Time Waveform" <- w7
  call "Power Spectral Density for 1 Chan.gvi"(signal=w7) -> (power spectral density=w8)
  $"AM Signal PSD" <- w8
