vi "AMCoherent.gvi"   [LabVIEW NXG 3.1.0]
panel controls:
  "Message Freq": f64 = 10
  "Message Amp": f64 = 1
  "Carrier Freq": f64 = 10
  "Carrier Amp": f64 = 1
  "sample rate": f64 = 1000
  "samples": i32 = 1000
  "Carrier Signal": waveform<f64> = {dt=1, Y=[]}
  "cutoff frequency": f64 = 0.125
  "order": i32 = 2
  "Waveform": waveform<f64> = {dt=0.1, Y=[]}
  "AM Signal": waveform<f64> = {dt=1, Y=[]}
panel indicators:
  "Demodulate Signal Time Waveform": waveform<f64>
  "Demodulated Signal PSD": T1
types:
  T1 = cluster{"f0": f64, "df": f64, "magnitude": f64[]}
uses:
  NI::Analysis::Filtering::Butterworth Lowpass Filter (Waveform).gvi
  NI::Analysis::Measurement::AC DC and RMS (single-shot)(Wfm).gvi
  NI::Analysis::Measurement::Power Spectral Density for 1 Chan.gvi
diagram:
  call "AM.gvi"(Message Freq=$"Message Freq", Message Amp=$"Message Amp", Carrier Freq=$"Carrier Freq", Carrier Amp=$"Carrier Amp", sample rate=$"sample rate", samples=$samples) -> (Carrier Signal Time Waveform=w1, AM Signal Time Waveform=w2)
  Waveform Multiply(w1, w2) -> w3
  call "Butterworth Lowpass Filter (Waveform).gvi"(signal=w3, cutoff frequency=$"cutoff frequency", order=$order) -> (filtered signal=w4)
  call "AC DC and RMS (single-shot)(Wfm).gvi"(signal=w4) -> (DC value=w5)
  Waveform Subtract(x=w4, y=w5) -> w6
  $"Demodulate Signal Time Waveform" <- w6
  call "Power Spectral Density for 1 Chan.gvi"(signal=w6) -> (power spectral density=w7)
  $"Demodulated Signal PSD" <- w7
