vi "AMEnvelopeDetection.gvi"   [LabVIEW NXG 5.1.0]
inputs:
  "AM signal": waveform<f64> = {dt=1, Y=[]}
  "order": i32 = 2
  "cutoff frequency": f64 = 0.125
outputs:
  "demodulated signal in time": waveform<f64>
  "demodulated signal PSD": T1
panel indicators:
  "Output": f64[]
types:
  T1 = cluster{"f0": f64, "df": f64, "magnitude": f64[]}
uses:
  NI::Analysis::Measurement::Power Spectral Density (Single Shot) (Wfm DBL).gvi
  NI::Analysis::Filtering::Butterworth Lowpass Filter (Waveform).gvi
  NI::Analysis::Measurement::AC DC and RMS (single-shot)(Wfm).gvi
diagram:
  call "Power Spectral Density (Single Shot) (Wfm DBL).gvi"(signal=$"AM signal")
  Waveform Multiply($"AM signal", f64 default) -> w1
  Property Node(instance in=w1) -> ("Y"=w2, "dt"=w3)
  Array Size(array=w2) -> (size(s)=w4)
  for (N = w4) (iteration -> i1) {
    Array Index(array=w2) -> (out0[i1]=w6)
    Is Less Than 0(x=w6) -> w7
    case (w7) {
      frame False, Default {
        w8 = w6
      }
      frame True {
        w8 = 0
      }
    }
    append w8 to w5
  }
  $Output <- w5
  Build Waveform Node(Y=w5, dt=w3) -> (output waveform=w9)
  call "Power Spectral Density (Single Shot) (Wfm DBL).gvi"(signal=w9)
  call "Butterworth Lowpass Filter (Waveform).gvi"(signal=w9, cutoff frequency=$"cutoff frequency", order=$order) -> (filtered signal=w10)
  call "AC DC and RMS (single-shot)(Wfm).gvi"(signal=w10) -> (DC value=w11)
  Waveform Subtract(x=w10, y=w11) -> w12
  $"demodulated signal in time" <- w12
  call "Power Spectral Density (Single Shot) (Wfm DBL).gvi"(signal=w12) -> (power spectral density=w13)
  $"demodulated signal PSD" <- w13
