vi "Function.gvi"   [LabVIEW NXG 3.1.0]
panel controls:
  "samples": i32 = 1000
  "sample rate": f64 = 1000
  "Message Freq": f64 = 10
  "Message Amp": f64 = 1
  "Carrier Freq": f64 = 10
  "Carrier Amp": f64 = 1
  "cutoff frequency": f64 = 0.125
  "order": i32 = 2
panel indicators:
  "demodulated signal in time (coherent)": waveform<f64>
  "demodulated signal in frequency (coherent)": T1
  "demodulated signal in time (envelope)": waveform<f64>
  "demodulated signal in frequency (envelope)": T1
types:
  T1 = cluster{"f0": f64, "df": f64, "magnitude": f64[]}
diagram:
  call "AM.gvi"(Message Freq=$"Message Freq", Message Amp=$"Message Amp", Carrier Freq=$"Carrier Freq", Carrier Amp=$"Carrier Amp", sample rate=$"sample rate", samples=$samples) -> (Carrier Signal Time Waveform=w1, AM Signal Time Waveform=w2)
  call "AMCoherent.gvi"(Carrier Signal=w1, AM Signal=w2, cutoff frequency=$"cutoff frequency", order=$order) -> (demodulated signal in time=w3, demodulated signal in frequency=w4)
  $"demodulated signal in time (coherent)" <- w3
  $"demodulated signal in frequency (coherent)" <- w4
  call "AMEnvelopeDetection.gvi"(AM signal=w2, cutoff frequency=$"cutoff frequency", order=$order) -> (demodulated signal in time=w5, demodulated signal in frequency=w6)
  $"demodulated signal in time (envelope)" <- w5
  $"demodulated signal in frequency (envelope)" <- w6
