vi "Simple Sound.gvi"   [LabVIEW NXG 3.1.0]
inputs:
  "device ID": u32
  "error in (no error)": error
  "sound format": T1 = {"sample rate (S/s)"=44100, "number of channels"=1, "bits per sample"=16}
  "Action": enum{"Open", "Write", "Close"} = "Write"
  "data": waveform<f64> = {dt=1, Y=[]}
  "task ID in": "Sound Output Reference.gtype"
outputs:
  "sample rate (S/s)": f64
  "Error": error
  "task ID out": "Sound Output Reference.gtype"
  "device ID out": u32
types:
  T1 = cluster{"sample rate (S/s)": f64, "number of channels": i32, "bits per sample": i32}
  "Sound Output Reference.gtype" = u32
uses:
  NI::G Core::Sound::Output::Sound Output Configure.gvi
  NI::G Core::Sound::Output::Sound Output Write::Sound Output Write.gvi
  NI::G Core::Sound::Output::Sound Output Clear.gvi
diagram:
  Property Node(instance in=$"sound format") -> ("sample rate (S/s)"=w1)
  $"sample rate (S/s)" <- w1
  case ($Action) {
    frame "Open" {
      call "Sound Output Configure.gvi"(device ID=$"device ID", sound format=$"sound format", error in=$"error in (no error)") -> (task ID=w3, error out=w2)
      w4 = $"device ID"
    }
    frame "Write", Default {
      Property Node(instance in=$data) -> ("Y"=w5)
      Array Max And Min(array=w5) -> (max value=w6)
      Waveform Divide(error in=$"error in (no error)", x=$data, y=w6) -> (error out=w7, x/y=w8)
      Build Array(w8) -> w9
      call "Sound Output Write.gvi"(task ID in=$"task ID in", data=w9, error in=w7) -> (task ID out=w3, error out=w2)
      w4 = $"device ID"
    }
    frame "Close" {
      call "Sound Output Clear.gvi"(task ID=$"task ID in", error in=$"error in (no error)") -> (error out=w2)
      w3 = 0x0
      w4 = $"device ID"
    }
  }
  $"device ID out" <- w4
  $"task ID out" <- w3
  $Error <- w2
