vi "USRP_AM_Rx.gvi"   [LabVIEW NXG 3.1.0]
panel controls:
  "number of samples": i64 = 200000
  "IQ rate": f64 = 500000
  "carrier frequency": f64 = 400000000
  "gain": f64
  "active antenna": string = "RX2"
  "Stop": bool
  "device names": "USRP niUSRPClass"
  "low cutoff frequency": f64 = 500
panel indicators:
  "coerced IQ rate": f64
  "coerced carrier frequency": f64
  "coerced gain": f64
  "Error Out": error
  "Demodulated signal": waveform<f64>
  "Demodulated PSD": T1
types:
  T1 = cluster{"f0": f64, "df": f64, "magnitude": f64[]}
uses:
  NI::USRP::niUSRP Open Rx Session.gvi
  NI::USRP::niUSRP Configure Signal.gvi
  NI::USRP::niUSRP Initiate.gvi
  NI::USRP::niUSRP Fetch Rx Data (CDB WDT).gvi
  NI::Analysis::Measurement::AC DC and RMS (single-shot)(1D DBL).gvi
  NI::Analysis::Filtering::Butterworth Lowpass Filter (DBL).gvi
  NI::Analysis::Measurement::Power Spectrum for 1 Chan.gvi
  NI::USRP::niUSRP Abort.gvi
  NI::USRP::niUSRP Close Session.gvi
diagram:
  call "niUSRP Open Rx Session.gvi"(device names=$"device names") -> (session handle out=w1, error out=w2)
  call "niUSRP Configure Signal.gvi"(active antenna=$"active antenna", session handle=w1, error in=w2, IQ rate=$"IQ rate", carrier frequency=$"carrier frequency", gain=$gain) -> (session handle out=w3, error out=w4, coerced IQ rate=w5, coerced carrier frequency=w6, coerced gain=w7)
  $"coerced IQ rate" <- w5
  $"coerced carrier frequency" <- w6
  call "niUSRP Initiate.gvi"(session handle=w3, error in=w4) -> (session handle out=w8, error out=w9)
  w10 = $"number of samples"
  w11 = $"low cutoff frequency"
  while {
    call "niUSRP Fetch Rx Data (CDB WDT).gvi"(session handle=w8, error in=w9, number of samples=w10) -> (session handle out=w12, error out=w13, data=w14)
    Property Node(instance in=w14) -> ("Y"=w15, "t0"=w16, "dt"=w17)
    Reciprocal(x=w17) -> w18
    Complex To Real Imaginary(x + iy=w15) -> (x=w19)
    call "AC DC and RMS (single-shot)(1D DBL).gvi"(signal=w19) -> (DC value=w20)
    Subtract(x=w19, y=w20) -> w21
    call "Butterworth Lowpass Filter (DBL).gvi"(signal=w21, sampling frequency=w18, cutoff frequency=w11, order=5) -> (filtered signal=w22)
    Build Waveform Node(Y=w22, dt=w17, t0=w16) -> (output waveform=w23)
    $"Demodulated signal" <- w23
    call "Power Spectrum for 1 Chan.gvi"(signal=w23) -> (power spectrum=w24)
    $"Demodulated PSD" <- w24
    Property Node(instance in=w13) -> ("status"=w25)
    Logical Or(w25, $Stop) -> w26
    stop if w26
  }
  call "niUSRP Abort.gvi"(session handle=w12, error in=w13) -> (session handle out=w27, error out=w28)
  call "niUSRP Close Session.gvi"(session handle=w27, error in=w28) -> (error out=w29)
  $"Error Out" <- w29
  $"coerced gain" <- w7
