vi "USRP_AM_Rx_Music.gvi"   [LabVIEW NXG 3.1.0]
panel controls:
  "number of samples": i64 = 1000000
  "IQ rate": f64 = 100000
  "carrier frequency": f64 = 400000000
  "gain": f64
  "active antenna": string = "RX2"
  "Stop": bool
  "device names": "USRP niUSRPClass"
panel indicators:
  "coerced IQ rate": f64
  "coerced carrier frequency": f64
  "coerced gain": f64
  "Demodulated signal": waveform<f64>
  "Demodulated PSD": T1
  "error out": error
types:
  T1 = cluster{"f0": f64, "df": f64, "magnitude": f64[]}
uses:
  NI::USRP::niUSRP Open Rx Session.gvi
  NI::USRP::niUSRP Configure Signal.gvi
  NI::USRP::niUSRP Initiate.gvi
  NI::USRP::niUSRP Fetch Rx Data (CDB WDT).gvi
  NI::Analysis::Measurement::AC DC and RMS (single-shot)(1D DBL).gvi
  NI::Analysis::Measurement::Power Spectrum for 1 Chan.gvi
  NI::USRP::niUSRP Abort.gvi
  NI::USRP::niUSRP Close Session.gvi
diagram:
  call "niUSRP Open Rx Session.gvi"(device names=$"device names") -> (session handle out=w1, error out=w2)
  call "niUSRP Configure Signal.gvi"(active antenna=$"active antenna", session handle=w1, error in=w2, IQ rate=$"IQ rate", carrier frequency=$"carrier frequency", gain=$gain) -> (session handle out=w3, error out=w4, coerced IQ rate=w5, coerced carrier frequency=w6, coerced gain=w7)
  $"coerced IQ rate" <- w5
  $"coerced carrier frequency" <- w6
  call "niUSRP Initiate.gvi"(session handle=w3, error in=w4) -> (session handle out=w8, error out=w9)
  call "Simple Sound.gvi"(Action="Open") -> (sample rate (S/s)=w10, task ID out=w11, device ID out=w12, Error=w13)
  w14 = $"number of samples"
  while {
    Reciprocal(x=44100) -> w15
    call "niUSRP Fetch Rx Data (CDB WDT).gvi"(session handle=w8, error in=w9, number of samples=w14) -> (session handle out=w16, error out=w17, data=w18)
    Property Node(instance in=w18) -> ("Y"=w19, "t0"=w20)
    Complex To Polar(r * e^(i*theta)=w19) -> (r=w21)
    call "AC DC and RMS (single-shot)(1D DBL).gvi"(signal=w21) -> (DC value=w22)
    Subtract(x=w21, y=w22) -> w23
    call "Simple Resample.gvi"(input=w23, coerced IQ rate=44100, sample rate (S/s)=w10) -> (output=w24)
    Build Waveform Node(Y=w24, dt=w15) -> (output waveform=w25)
    call "Simple Sound.gvi"(Action="Write", data=w25, device ID=w12, task ID in=w11, error in (no error)=w13) -> (task ID out=w26, device ID out=w27, Error=w28)
    Build Waveform Node(Y=w23, dt=w15, t0=w20) -> (output waveform=w29)
    $"Demodulated signal" <- w29
    call "Power Spectrum for 1 Chan.gvi"(signal=w29) -> (power spectrum=w30)
    $"Demodulated PSD" <- w30
    Wait(time to wait=100)
    Property Node(instance in=w17) -> ("status"=w31)
    Logical Or(w31, $Stop) -> w32
    stop if w32
  }
  call "Simple Sound.gvi"(Action="Close", device ID=w27, task ID in=w26, error in (no error)=w28) -> (Error=w33)
  Merge Errors(w33, w17) -> (error out=w34)
  call "niUSRP Abort.gvi"(session handle=w16, error in=w34) -> (session handle out=w35, error out=w36)
  call "niUSRP Close Session.gvi"(session handle=w35, error in=w36) -> (error out=w37)
  $"error out" <- w37
  $"coerced gain" <- w7
