vi "FMTopLevel.gvi"   [LabVIEW NXG 3.1.0]
panel controls:
  "samples": i32 = 1000
  "sample rate": f64 = 1000
  "f_c": f64 = 10
  "f_m": f64 = 10
  "k_f": f64
  "cutoff frequency": f64 = 0.125
  "order": i32 = 2
  "stop": bool
panel indicators:
  "demodulated signal in time": waveform<f64>
  "demodulated signal in frequency": T1
  "modulated signal in time": waveform<f64>
  "modulated signal in frequency": T1
types:
  T1 = cluster{"f0": f64, "df": f64, "magnitude": f64[]}
diagram:
  while {
    call "FM_Modulator.gvi"(f_c=$f_c, f_m=$f_m, k_f=$k_f, sample rate=$"sample rate", samples=$samples) -> (psd of s(t)=w1, s(t)=w2)
    $"modulated signal in frequency" <- w1
    $"modulated signal in time" <- w2
    call "FM_Demodulator.gvi"(waveform in=w2, k_f=$k_f, cutoff frequency=$"cutoff frequency", order=$order) -> (demodulated signal in time=w3, demodulated signal in frequency=w4)
    $"demodulated signal in time" <- w3
    $"demodulated signal in frequency" <- w4
    stop if $stop
  }
