vi "FM_Demodulator.gvi"   [LabVIEW NXG 3.1.0]
inputs:
  "waveform in": waveform<f64> = {dt=1, Y=[]}
  "k_f": f64
  "cutoff frequency": f64 = 0.125
  "order": i32 = 2
outputs:
  "demodulated signal in time": waveform<f64>
  "demodulated signal in frequency": T1
  "derivate": waveform<f64>
types:
  T1 = cluster{"f0": f64, "df": f64, "magnitude": f64[]}
uses:
  NI::Analysis::IntegralDifferentiation::Derivative x(t).gvi
diagram:
  Property Node(instance in=$"waveform in") -> ("Y"=w1, "dt"=w2, "t0"=w3)
  call "Derivative x(t).gvi"(dt=w2, x(t)=w1) -> (dx(t)/dt=w4)
  Build Waveform Node(Y=w4, dt=w2, t0=w3) -> (output waveform=w5)
  Waveform Multiply(-1, w5) -> w6
  $derivate <- w6
  Multiply($k_f, f64 default) -> w7
  Waveform Divide(x=w6, y=w7) -> w8
  call "AMEnvelopeDetection.gvi"(AM signal=w8, cutoff frequency=$"cutoff frequency", order=$order) -> (demodulated signal in time=w9, demodulated signal in frequency=w10)
  $"demodulated signal in time" <- w9
  $"demodulated signal in frequency" <- w10
