vi "FM_Modulator.gvi"   [LabVIEW NXG 3.1.0]
inputs:
  "f_c": f64 = 10
  "f_m": f64 = 10
  "k_f": f64
  "sample rate": f64 = 1000
  "samples": i32 = 1000
outputs:
  "s(t)": waveform<f64>
  "psd of s(t)": T1
types:
  T1 = cluster{"f0": f64, "df": f64, "magnitude": f64[]}
uses:
  NI::Analysis::Generation::Sine Waveform.gvi
  NI::Analysis::IntegralDifferentiation::Integral x(t).gvi
  NI::Analysis::Measurement::Power Spectral Density for 1 Chan.gvi
diagram:
  call "Sine Waveform.gvi"(sample rate=$"sample rate", samples=$samples, amplitude=1, frequency=$f_c, phase in=0) -> (sine wave=w1)
  call "Sine Waveform.gvi"(sample rate=$"sample rate", samples=$samples, amplitude=1, frequency=$f_m, phase in=0) -> (sine wave=w2)
  Property Node(instance in=w2) -> ("Y"=w3, "dt"=w4, "t0"=w5)
  call "Integral x(t).gvi"(dt=w4, x(t)=w3) -> (integral x(t)=w6)
  Multiply(2, f64 default) -> w7
  Multiply(w7, $k_f) -> w8
  Multiply(w8, w6) -> w9
  Sine And Cosine(x=w9) -> (cos(x)=w10, sin(x)=w11)
  Build Waveform Node(Y=w11, dt=w4, t0=w5) -> (output waveform=w12)
  Waveform Multiply(w1, w12) -> w13
  call "Sine Waveform.gvi"(sample rate=$"sample rate", samples=$samples, amplitude=1, frequency=$f_c, phase in=90) -> (sine wave=w14)
  Build Waveform Node(Y=w10, dt=w4, t0=w5) -> (output waveform=w15)
  Waveform Multiply(w15, w14) -> w16
  Waveform Add(w13, w16) -> w17
  $"s(t)" <- w17
  call "Power Spectral Density for 1 Chan.gvi"(signal=w17) -> (power spectral density=w18)
  $"psd of s(t)" <- w18
