vi "Find Radio Station.gvi"   [LabVIEW Communications System Design Suite 2.0.1]
panel controls:
  "IQ rate": f64 = 20000000
  "carrier frequency": f64 = 90000000
  "gain (dB)": f64
  "active antenna": string = "RX1"
  "timeout": f64 = 10
  "number of samples": i64 = 200000
  "device names": "niUSRPClass"
panel indicators:
  "coerced gain": f64
  "coerced frequency": f64
  "coerced IQ rate": f64
  "Frequency Plot": T1
  "Error Out": error
types:
  T1 = cluster{"f0": f64, "df": f64, "magnitude": f64[]}
uses:
  NI::Analysis::Measurement::FFT Power Spectrum for 1 Chan Compatibility (CDB).gvi
diagram:
  call "niUSRP Open Rx Session.gvi"(device names=$"device names") -> (error out=w1, session handle out=w2)
  call "niUSRP Configure Signal.gvi"(session handle=w2, IQ rate=$"IQ rate", carrier frequency=$"carrier frequency", gain=$"gain (dB)", error in=w1, active antenna=$"active antenna") -> (session handle out=w3, coerced IQ rate=w4, coerced carrier frequency=w5, coerced gain=w6, error out=w7)
  call "niUSRP Initiate.gvi"(session handle=w3, error in=w7) -> (session handle out=w8, error out=w9)
  call "niUSRP Fetch Rx Data (CDB).gvi"(session handle=w8, number of samples=$"number of samples", timeout=$timeout, error in=w9) -> (session handle out=w10, data=w11, error out=w12)
  call "niUSRP Abort.gvi"(session handle=w10, error in=w12) -> (session handle out=w13, error out=w14)
  call "niUSRP Close Session.gvi"(session handle=w13, error in=w14) -> (error out=w15)
  $"Error Out" <- w15
  Reciprocal(x=w4) -> w16
  w17 = cluster{"t0": timestamp, "dt": f64, "Y": c128[]} {all zero or empty}
  Property Node(instance in=w17, "Y"=w11, "dt"=w16) -> (instance out=w18)
  call "FFT Power Spectrum for 1 Chan Compatibility (CDB).gvi"(signal=w18, dB on=TRUE) -> (power spectrum=w19)
  $"Frequency Plot" <- w19
  $"coerced IQ rate" <- w4
  $"coerced frequency" <- w5
  $"coerced gain" <- w6
