vi "Simple Sound.gvi"   [LabVIEW NXG 3.1.0]
inputs:
  "task ID in": "Sound Output Reference.gtype"
  "error in (no error)": error
  "sound format": "sound format.gtype" = {"sample rate (S/s)"=44100, "number of channels"=1, "bits per sample"=16}
  "Action": enum{"Open", "Write", "Close"} = "Write"
  "data": waveform<f64> = {dt=1, Y=[]}
  "device ID": u32
outputs:
  "sample rate (S/s)": f64
  "Error": error
  "task ID out": "Sound Output Reference.gtype"
types:
  "sound format.gtype" = cluster{"sample rate (S/s)": f64, "number of channels": i32, "bits per sample": i32}
  "Sound Output Reference.gtype" = u32
uses:
  NI::G Core::Sound::Output::Sound Output Configure.gvi
  NI::G Core::Sound::Output::Sound Output Write::Sound Output Write.gvi
  NI::G Core::Sound::Output::Sound Output Clear.gvi
diagram:
  case ($Action) {
    frame "Open" {
      call "Sound Output Configure.gvi"(device ID=$"device ID", sound format=$"sound format", error in=$"error in (no error)") -> (task ID=w2, error out=w1)
    }
    frame "Write", Default {
      Property Node(instance in=$data) -> ("Y"=w3)
      Array Max And Min(array=w3) -> (max value=w4)
      Waveform Divide(error in=$"error in (no error)", x=$data, y=w4) -> (error out=w5, x/y=w6)
      Build Array(w6) -> w7
      call "Sound Output Write.gvi"(task ID in=$"task ID in", data=w7, error in=w5) -> (task ID out=w2, error out=w1)
    }
    frame "Close" {
      call "Sound Output Clear.gvi"(task ID=$"task ID in", error in=$"error in (no error)") -> (error out=w1)
      w2 = 0x0
    }
  }
  $"task ID out" <- w2
  $Error <- w1
  Property Node(instance in=$"sound format") -> ("sample rate (S/s)"=w8)
  $"sample rate (S/s)" <- w8
