vi "ma_FFT with Hanning.gvi"   [LabVIEW NXG]
inputs:
  "time signal data": f64[]
  "correct DC": bool = TRUE
  "exclude Nyquist": bool = TRUE
outputs:
  "complex Hann spectrum": c128[]
  "FFT size": i32
diagram:
  s1 = uninitialised  # shift register
  s2 = uninitialised  # shift register
  while {
    Square Root(x=2) -> w1
    Array Size(array=$"time signal data") -> (size(s)=w2)
    Is Not Equal(x=w2, y=s2) -> w3
    case (w3) {
      frame False, Default {
        w4 = s1
      }
      frame True {
        call "ma_Calculate window.gvi"(window="Hanning", array size=w2) -> (Window data=w5)
        Divide(x=w5, y=w1) -> w4
      }
    }
    Multiply($"time signal data", w4) -> w6
    Divide(x=w2, y=2) -> w7
    Divide(x=w6, y=w7) -> w8
    call "Real FFT.gvi"(x=w8) -> (FFT {x}=w9)
    Increment(x=w2) -> w10
    Increment(x=w10) -> w11
    Select(s=$"exclude Nyquist", t=w10, f=w11) -> w12
    Quotient And Remainder(x=w12, y=2) -> (floor(x/y)=w13)
    Array Subset(array=w9, index0=0, length0=w13) -> w14
    case ($"correct DC") {
      frame False, Default {
        w15 = w14
      }
      frame True {
        Array Index(array=w14) -> (out0[0]=w16)
        Divide(x=w16, y=w1) -> w17
        Replace Array Subset(inArray=w14, 0, w17) -> w15
      }
    }
    $"complex Hann spectrum" <- w15
    $"FFT size" <- w2
    next s1 = w4
    next s2 = w2
    continue if FALSE
  }
