vi "ma_Generate Multitone Phases.gvi"   [LabVIEW NXG]
inputs:
  "#tones": i32 = 10
  "seed": i32 = -1
  "phase relationship": u16
outputs:
  "Tone Phases": f64[]
diagram:
  case ($"phase relationship") {
    frame 0, Default {
      call "Uniform White Noise (obs 90).gvi"(samples=$"#tones", amplitude=360, seed=$seed) -> (uniform white noise=w1)
    }
    frame 1 {
      Divide(x=360, y=$"#tones") -> w2
      s1 = 0  # shift register
      for (N = $"#tones") (iteration -> i1) {
        Multiply(w2, i1) -> w3
        Add(w3, s1) -> w4
        append w4 to w1
        next s1 = w4
      }
    }
    frame 2 {
      Divide(x=360, y=$"#tones") -> w5
      for (N = $"#tones") (iteration -> i2) {
        Multiply(w5, i2) -> w6
        append w6 to w1
      }
    }
  }
  $"Tone Phases" <- w1
