vi "DPSK_Tx_Rx.gvi"   [LabVIEW NXG 3.1.0]
panel controls:
  "IQ rate": f64 = 200000
  "device names": "USRP niUSRPClass"
  "carrier frequency": f64 = 400000000
  "gain Tx": f64
  "active antenna Tx": string = "TX1"
  "stop Tx": bool
  "gain Rx": f64
  "active antenna Rx": string = "RX2"
  "total bits": i32 = 128
  "M": i32 = 16
  "message length": i32
panel indicators:
  "Baseband Waveform": waveform<f64>
  "Baseband Power Spectrum_Tx": T1
  "Baseband Power Spectrum_Rx": T1
  "Baseband Waveform_2": waveform<c128>
  "BER": f64
  "trigger found?": bool
  "subarray": i16[]
types:
  T1 = cluster{"f0": f64, "df": f64, "magnitude": f64[]}
uses:
  NI::Modulation::MT Generate Bits (Fibonacci, PN Order).gvi
  NI::Analysis::Resampling::Upsample (DBL).gvi
  NI::Modulation::MT Generate Filter Coefficients.gvi
  NI::Analysis::Operations::1D Convolution (DBL).gvi
  NI::USRP::niUSRP Open Rx Session.gvi
  NI::USRP::niUSRP Configure Signal.gvi
  NI::USRP::niUSRP Initiate.gvi
  NI::USRP::niUSRP Fetch Rx Data (CDB).gvi
  NI::Analysis::Operations::1D Convolution (CDB).gvi
  NI::USRP::niUSRP Close Session.gvi
  NI::Analysis::Resampling::Decimate (single shot, CDB).gvi
  NI::Modulation::MT Calculate BER After Trigger (Fibonacci PN Sequence).gvi
  NI::USRP::niUSRP Open Tx Session.gvi
  NI::USRP::niUSRP Write Tx Data (CDB).gvi
diagram:
  # Transmitter
  Reciprocal(x=$"IQ rate") -> w1
  call "MT Generate Bits (Fibonacci, PN Order).gvi"(total bits=$"total bits") -> (output bit stream=w2)
  Multiply(w2, 2) -> w3
  Subtract(x=w3, y=1) -> w4
  call "AddFrameHeader.gvi"(array=w4) -> (output array=w5)
  s1 = uninitialised  # shift register
  for (iteration -> i1) {
    w6 = each element of w5
    Is Equal To 0(x=i1) -> w8
    case (w8) {
      frame False, Default {
        Multiply(s1, w6) -> w9
      }
      frame True {
        w9 = 1
      }
    }
    append w9 to w7
    next s1 = w9
  }
  call "Upsample (DBL).gvi"(signal=w7, upsampling factor=20) -> (upsampled signal=w10)
  call "MT Generate Filter Coefficients.gvi"(pulse shaping filter="Root Raised Cos", pulse shaping samples per symbol=20, modulation type="PSK") -> (pulse shaping filter coefficients=w11)
  call "1D Convolution (DBL).gvi"(x=w10, y=w11) -> (x * y=w12)
  call "Quick Scale 1D.gvi"(X=w12) -> (max|X|=w13)
  Divide(x=w12, y=w13) -> w14
  Build Waveform Node(Y=w14, dt=w1) -> (output waveform=w15)
  $"Baseband Waveform" <- w15
  # Receiver
  call "niUSRP Open Rx Session.gvi"(device names=$"device names") -> (session handle out=w16, error out=w17)
  call "niUSRP Configure Signal.gvi"(active antenna=$"active antenna Rx", session handle=w16, error in=w17, IQ rate=$"IQ rate", carrier frequency=$"carrier frequency", gain=$"gain Rx") -> (session handle out=w18, error out=w19, coerced carrier frequency=w20)
  Subtract(x=w20, y=20000) -> w21
  Property Node(instance in=w18, "niUSRP"=w21) -> (instance out=w22)
  call "niUSRP Initiate.gvi"(session handle=w22, error in=w19) -> (session handle out=w23, error out=w24)
  call "niUSRP Fetch Rx Data (CDB).gvi"(session handle=w23, error in=w24, number of samples=1000000) -> (session handle out=w25, error out=w26, data=w27)
  call "MT Generate Filter Coefficients.gvi"(pulse shaping filter="Root Raised Cos", matched samples per symbol=$M, modulation type="PSK") -> (matched filter coefficients=w28)
  call "1D Convolution (CDB).gvi"(x=w28, y=w27) -> (x * y=w29)
  Build Waveform Node(Y=w29, dt=w1) -> (output waveform=w30)
  $"Baseband Waveform_2" <- w30
  w31 = cluster{"t0": timestamp, "dt": f64, "Y": c128[]} {all zero or empty}
  Property Node(instance in=w31, "dt"=w1, "Y"=w29) -> (instance out=w32)
  call "FFT Power Spectrum for 1 Chan (CDB)2.gvi"(time signal=w32, dB On (F)=TRUE) -> (power spectrum=w33)
  $"Baseband Power Spectrum_Rx" <- w33
  call "niUSRP Close Session.gvi"(session handle=w25, error in=w26)
  w34 = cluster{"t0": timestamp, "dt": f64, "Y": c128[]} {all zero or empty}
  Real And Imaginary To Complex(x=w14, y=0) -> w35
  Property Node(instance in=w34, "Y"=w35, "dt"=w1) -> (instance out=w36)
  call "FFT Power Spectrum for 1 Chan (CDB)2.gvi"(time signal=w36, dB On (F)=TRUE) -> (power spectrum=w37)
  $"Baseband Power Spectrum_Tx" <- w37
  call "PulseAlign (Complex).gvi"(Input signal=w29, Receiver Sampling Factor=$M) -> (aligned output=w38)
  call "Decimate (single shot, CDB).gvi"(signal=w38, decimating factor=$M) -> (decimated signal=w39)
  s2 = uninitialised  # shift register
  for (iteration -> i2) {
    w40 = each element of w39
    Is Equal To 0(x=i2) -> w42
    case (w42) {
      frame False, Default {
        Complex Conjugate(x + iy=s2) -> w44
        Multiply(w44, w40) -> w43
      }
      frame True {
        w43 = 1+0i
      }
    }
    Complex To Real Imaginary(x + iy=w43) -> (x=w45)
    append w45 to w41
    next s2 = w43
  }
  call "FrameSync (Real).gvi"(Sampled Input=w41) -> (Aligned Samples=w46)
  for {
    w47 = each element of w46
    Is Greater Than 0(x=w47) -> w49
    Boolean To Integer(Boolean=w49) -> (0, 1=w50)
    append w50 to w48
  }
  Array Subset(array=w48, index0=0, length0=$"message length") -> w51
  $subarray <- w51
  call "MT Calculate BER After Trigger (Fibonacci PN Sequence).gvi"(input bit stream=w51, BER trigger threshold=0.4) -> (BER=w52, trigger found?=w53)
  $BER <- w52
  $"trigger found?" <- w53
  call "niUSRP Open Tx Session.gvi"(device names=$"device names") -> (session handle out=w54, error out=w55)
  call "niUSRP Configure Signal.gvi"(active antenna=$"active antenna Tx", session handle=w54, error in=w55, IQ rate=$"IQ rate", carrier frequency=$"carrier frequency", gain=$"gain Tx") -> (session handle out=w56, error out=w57)
  while {
    call "niUSRP Write Tx Data (CDB).gvi"(session handle=w56, error in=w57, data=w35) -> (session handle out=w58, error out=w59)
    stop if $"stop Tx"
  }
  call "niUSRP Close Session.gvi"(session handle=w58, error in=w59)
