vi "bpsk_tx.gvi"   [LabVIEW NXG 3.1.0]
panel controls:
  "total bits": i32 = 128
  "IQ rate": f64
panel indicators:
  "Baseband Waveform": waveform<f64>
  "Baseband Power Spectrum_Tx": T1
types:
  T1 = cluster{"f0": f64, "df": f64, "magnitude": f64[]}
uses:
  NI::Modulation::MT Generate Bits (Fibonacci, PN Order).gvi
  NI::Analysis::Resampling::Upsample (DBL).gvi
  NI::Modulation::MT Generate Filter Coefficients.gvi
  NI::Analysis::Operations::1D Convolution (DBL).gvi
diagram:
  Reciprocal(x=$"IQ rate") -> w1
  call "MT Generate Bits (Fibonacci, PN Order).gvi"(total bits=$"total bits") -> (output bit stream=w2)
  Multiply(w2, 2) -> w3
  Subtract(x=w3, y=1) -> w4
  call "AddFrameHeader.gvi"(array=w4) -> (output array=w5)
  call "Upsample (DBL).gvi"(signal=w5, upsampling factor=20) -> (upsampled signal=w6)
  call "MT Generate Filter Coefficients.gvi"(pulse shaping filter="none", pulse shaping samples per symbol=20, modulation type="PSK") -> (pulse shaping filter coefficients=w7)
  call "1D Convolution (DBL).gvi"(x=w6, y=w7) -> (x * y=w8)
  call "Quick Scale 1D.gvi"(X=w8) -> (max|X|=w9)
  Divide(x=w8, y=w9) -> w10
  Build Waveform Node(Y=w10, dt=w1) -> (output waveform=w11)
  $"Baseband Waveform" <- w11
  Real And Imaginary To Complex(x=w10, y=0) -> w12
  w13 = cluster{"t0": timestamp, "dt": f64, "Y": c128[]} {all zero or empty}
  Property Node(instance in=w13, "Y"=w12, "dt"=w1) -> (instance out=w14)
  call "FFT Power Spectrum for 1 Chan (CDB)2.gvi"(time signal=w14, dB On (F)=TRUE) -> (power spectrum=w15)
  $"Baseband Power Spectrum_Tx" <- w15
