vi "FrameSync (Complex).gvi"   [LabVIEW Communications System Design Suite 2.0.1]
inputs:
  "Input Signal": cluster{"t0": f64, "dt": f64, "Y": c128[]}
  "Sampled Input": c128[]
  "Receiver Sampling Factor": f64 = 20
  "error in (no error)": error
outputs:
  "Output Signal": cluster{"t0": f64, "dt": f64, "Y": c128[]}
  "Aligned Samples": c128[]
  "max index": i32
  "error out": error
panel indicators:
  "Cross Correlation": f64[]
uses:
  NI::Analysis::Operations::1D Cross Correlation (CDB).gvi
  NI::Analysis::Measurement::Threshold Detector.gvi
diagram:
  case ($"error in (no error)") {
    frame No Error {
      Property Node(instance in=$"Input Signal") -> ("dt"=w4, "Y"=w5)
      Array Size(array=$"Sampled Input") -> (size(s)=w6)
      Absolute Value(x=$"Sampled Input") -> w7
      Square(x=w7) -> w8
      Add Array Elements(numeric array=w8) -> (sum=w9)
      Divide(x=w9, y=w6) -> w10
      Square Root(x=w10) -> w11
      Divide(x=$"Sampled Input", y=w11) -> w12
      Complex Conjugate(x + iy=w12) -> w13
      Build Array[ConcatenateInputs=True]([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], [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]) -> w14
      call "1D Cross Correlation (CDB).gvi"(x=w14, y=w13) -> (Rxy=w15, error out=w16)
      Absolute Value(x=w15) -> w17
      call "Threshold Detector.gvi"(signal=w17, threshold=20) -> (indices=w18)
      Array Index(array=w18) -> (out0[0]=w19)
      Increment(x=w19) -> w20
      Subtract(x=w20, y=26) -> w21
      Multiply($"Receiver Sampling Factor", w21) -> w22
      Array Subset(array=w5, index0=w22) -> w23
      w24 = cluster{"t0": f64, "dt": f64, "Y": c128[]} {all zero or empty}
      Property Node(instance in=w24, "dt"=w4, "Y"=w23) -> (instance out=w3)
      Array Subset(array=$"Sampled Input", index0=w20) -> w1
      $"Cross Correlation" <- w17
      $"max index" <- w19
      Property Node(instance in=w16) -> ("code"=w25)
      call "Error Cluster From Error Code.gvi"(error code=w25, error message="Sliding Correlator: crosscorrelation", error in=$"error in (no error)") -> (error out=w2)
    }
    frame Error {
      w26 = cluster{"t0": f64, "dt": f64, "Y": c128[]} {"t0"=0, "dt"=1, "Y"=[]}
      w1 = f64[] []
      w2 = $"error in (no error)"
      w3 = w26
    }
  }
  $"Output Signal" <- w3
  $"Aligned Samples" <- w1
  $"error out" <- w2
