vi "FrameSync (Real).gvi"   [LabVIEW Communications System Design Suite 2.0.1]
inputs:
  "Input Signal": cluster{"t0": f64, "dt": f64, "Y": f64[]}
  "Sampled Input": f64[]
  "Receiver Sampling Factor": f64 = 20
  "error in (no error)": error
outputs:
  "Output Signal": cluster{"t0": f64, "dt": f64, "Y": f64[]}
  "Aligned Samples": f64[]
  "max index": i32
  "error out": error
panel indicators:
  "Cross Correlation": f64[]
uses:
  NI::Analysis::Operations::1D Cross Correlation (DBL).gvi
  NI::Analysis::Measurement::Threshold Detector.gvi
diagram:
  case ($"error in (no error)") {
    frame No Error {
      Property Node(instance in=$"Input Signal") -> ("dt"=w4, "Y"=w5)
      Square(x=$"Sampled Input") -> w6
      Add Array Elements(numeric array=w6) -> (sum=w7)
      Array Size(array=$"Sampled Input") -> (size(s)=w8)
      To Double Precision Float(number=w8) -> w9
      Divide(x=w7, y=w9) -> w10
      Square Root(x=w10) -> w11
      Divide(x=$"Sampled Input", y=w11) -> w12
      Build Array[ConcatenateInputs=True]([1, 1, 1, 1, 1, -1, -1, 1, 1, -1, 1, -1, 1], [1, 1, 1, 1, 1, -1, -1, 1, 1, -1, 1, -1, 1]) -> w13
      call "1D Cross Correlation (DBL).gvi"(x=w13, y=w12) -> (Rxy=w14, error out=w15)
      Absolute Value(x=w14) -> w16
      call "Threshold Detector.gvi"(signal=w16, threshold=20) -> (indices=w17)
      Array Index(array=w17) -> (out0[0]=w18)
      Increment(x=w18) -> w19
      Subtract(x=w19, y=26) -> w20
      Multiply($"Receiver Sampling Factor", w20) -> w21
      Array Subset(array=w5, index0=w21) -> w22
      w23 = cluster{"t0": f64, "dt": f64, "Y": f64[]} {all zero or empty}
      Property Node(instance in=w23, "dt"=w4, "Y"=w22) -> (instance out=w3)
      $"Cross Correlation" <- w16
      Array Subset(array=$"Sampled Input", index0=w19) -> w1
      $"max index" <- w18
      call "Error Cluster From Error Code.gvi"(error message="Normalize", error in=$"error in (no error)") -> (error out=w24)
      Property Node(instance in=w15) -> ("code"=w25)
      call "Error Cluster From Error Code.gvi"(error code=w25, error message="Sliding Correlator: crosscorrelation", error in=w24) -> (error out=w2)
    }
    frame Error {
      w26 = cluster{"t0": f64, "dt": f64, "Y": f64[]} {all zero or empty}
      w1 = f64[] []
      w2 = $"error in (no error)"
      w3 = w26
    }
  }
  $"Output Signal" <- w3
  $"Aligned Samples" <- w1
  $"error out" <- w2
