vi "Insert Pilots.gvi"   [LabVIEW Communications System Design Suite 2.0.1]
inputs:
  "signal input": c128[]
outputs:
  "output signal": c128[]
diagram:
  Initialize Array(element=0.5+0.5i, size=2500) -> w1
  Initialize Array(element=0.5+0.5i, size=2500) -> w2
  Initialize Array(element=0.5+0.5i, size=2500) -> w3
  Initialize Array(element=0.5+0.5i, size=2500) -> w4
  Initialize Array(element=0.5+0.5i, size=2500) -> w5
  Initialize Array(element=0.5+0.5i, size=2500) -> w6
  Initialize Array(element=0.5+0.5i, size=2500) -> w7
  Initialize Array(element=0.5+0.5i, size=2500) -> w8
  Initialize Array(element=0.5+0.5i, size=2500) -> w9
  Interleave Array(w1, w2, w3, w4, w5, w6, w7, w8, w9) -> w10
  Build Array[ConcatenateInputs=True](w10, $"signal input") -> w11
  $"output signal" <- w11
