vi "PulseAlign (Complex).gvi"   [LabVIEW Communications System Design Suite 2.0.1]
inputs:
  "Input signal": c128[]
  "Receiver Sampling Factor": i32 = 100
  "error in (no error)": error
outputs:
  "aligned output": c128[]
  "alignment offset (samples)": i32
  "error out": error
panel indicators:
  "Objective Function": f64[]
uses:
  NI::Analysis::Resampling::Decimate (single shot, CDB).gvi
diagram:
  for (N = $"Receiver Sampling Factor") (iteration -> i1) {
    Array Subset(array=$"Input signal", index0=i1) -> w2
    call "Decimate (single shot, CDB).gvi"(input array=w2, decimating factor=$"Receiver Sampling Factor") -> (decimated array=w3, error out=w4)
    Complex To Polar(r * e^(i*theta)=w3) -> (r=w5)
    Square(x=w5) -> w6
    Add Array Elements(numeric array=w6) -> (sum=w7)
    Property Node(instance in=w4)
    append w7 to w1
  }
  $"Objective Function" <- w1
  Array Max And Min(array=w1) -> (max index(es)=w8)
  $"alignment offset (samples)" <- w8
  $"error out" <- $"error in (no error)"
  Array Subset(array=$"Input signal", index0=w8) -> w9
  $"aligned output" <- w9
